# Grasshopper definition relax.gh (Grasshopper 1.0.7)

number_slider = Slider(16247, range=0..100000)
rectangle = Rectangle(Plane=PlaneXY(0, 0, 0), XSize=number_slider, YSize=number_slider, Radius=0)  # -> Rectangle, Length
crv = Curve(<curve referenced from the Rhino model>)
number_slider_2 = Slider(1000, range=0..1000)
area = Area(Geometry=crv)  # -> Area, Centroid
crv_2 = Curve(<curve referenced from the Rhino model>)
sqrt = SquareRoot(Value=Slider(2, range=0..10))
scale = Scale(Geometry=crv, Center=area.Centroid, Factor=0.5)  # -> Geometry, Transform
toggle = BooleanToggle(True)
multiplication = Multiplication(A=number_slider_2, B=sqrt)
timer = Timer(TimerInterval=100, Target=c_script)
multiplication_2 = Multiplication(A=multiplication, B=Slider(2, range=0..10))
pop2d = Populate2D(Region=crv_2, Count=Slider(20, range=0..100), Seed=1)
addition = Addition(A=number_slider_2, B=multiplication_2)
c_script = CSharpScript(pts=pop2d, minDist=addition, region=crv, moveStep=number_slider_2, start=Toggle(False), reset=Button())  # -> out, A; inputs pts: list of Point3d, minDist: Double, region: Polyline, moveStep: Double, start: Boolean, reset: Boolean
# ---------- c_script: C# ----------
    if(reset) {
      centers = pts;
    }

    if(!start){
      A = centers;
      return;
    }

    var segments = new List<Line>();
    Print(region.SegmentCount.ToString());
    for(int i = 0; i < region.SegmentCount; i++)
    {
      segments.Add(region.SegmentAt(i));
    }

    var vectors = new List<Vector3d>();
    var counts = new List<double>();
    for(int i = 0; i < centers.Count; i++)
    {
      vectors.Add(Vector3d.Zero);
      counts.Add(0.0);


      for(int j = 0; j < centers.Count; j++)
      {
        Vector3d vec = centers[i] - centers[j];
        double dist = vec.Length;

        if(dist > minDist) continue;

        vec.Unitize();
        vectors[i] += vec;
        counts[i] += 1.0;
      }
    }

    //to in wall
    for(int i = 0; i < counts.Count; i++)
    {
      if(counts[i] == 0) continue;

      centers[i] += (vectors[i] / counts[i]) * moveStep;


      if(IsInside(centers[i], region)) continue;

      var nearWall = region.ClosestPoint(centers[i]);
      var vector = nearWall - centers[i];
      centers[i] = nearWall;
      vector.Unitize();
      centers[i] += vector * moveStep;
    }


    A = centers;
# ---------- c_script: C# additional code ----------
  List <Point3d> centers = new List<Point3d>();

  public static bool IsInside(Point3d pt, Polyline crv)
  {
    Point3d pt1, pt2;
    bool oddNodes = false;

    for (int i = 0; i < crv.SegmentCount; i++) //for each contour line
    {

      pt1 = crv.SegmentAt(i).From; //get start and end pt
      pt2 = crv.SegmentAt(i).To;

      if ((pt1[1] < pt[1] && pt2[1] >= pt[1] || pt2[1] < pt[1] && pt1[1] >= pt[1]) && (pt1[0] <= pt[0] || pt2[0] <= pt[0])) //if pt is between pts in y, and either of pts is before pt in x
        oddNodes ^= (pt2[0] + (pt[1] - pt2[1]) * (pt1[0] - pt2[0]) / (pt1[1] - pt2[1]) < pt[0]); //^= is xor
      //end.X + (pt-end).Y   * (start-end).X  /(start-end).Y   <   pt.X
    }


    if (!oddNodes)
    {
      double minDist = 1e10;
      for (int i = 0; i < crv.SegmentCount; i++)
      {
        Point3d cp = crv.SegmentAt(i).ClosestPoint(pt, true);
        //Point3d cp = mvContour[i].closestPoint(pt);
        //minDist = min(minDist, cp.distance(pt));
        minDist = Math.Min(minDist, cp.DistanceTo(pt));
      }
      if (minDist < 1e-10)
        return true;
    }

    if (oddNodes) return true;

    return false;
  }
  /// <summary>
  /// This method will be called once every solution, before any calls to RunScript.
  /// </summary>
# ---------- end c_script ----------
panel = Panel(c_script.A)
cir = Circle(Plane=c_script.A, Radius=expr("x/2", addition))
points = PointList(Points=c_script.A, Size=number_slider_2)
